# Grasshopper definition Pos_Tag_Empty_Space.gh (Grasshopper 1.0.8)
# plug-ins: Pufferfish, Rhino.Inside for Autodesk Revit

doubleclick = BooleanToggle(False)
dss_annotation_panel = Panel("Help on WhiteWork")
# Segment
# group modules into larger coherent parts
# User Interface: I/O
dss_log_v5_2 = PythonScript(Help=doubleclick)  # inputs Help: Boolean
# ---------- dss_log_v5_2: Python ----------
"""
Set grasshopper template and provide easy acces to Help file in intranet

"""

"""
Credits:
    20211117
    Created by Vladimir Ondejcik
    White arkitekter AB

Based on:
    WOMBAT version <0.0.1>
    Script by <Brian Ringley>
        def libraries() by <Giulio Piacentino> see <http://www.grasshopper3d.com/forum/topics/gh-filename-is-python>
        def writeToFile() by <Data Analytics Society> see <https://www.youtube.com/watch?v=-TF3mXhnCDw>
    Script version <15 September 2015> 
    Copyright <Creative Commons Sharealike>
"""


#add dsearch default path located on cad.local
import sys
new_path = r"\\sesthfs02\DSEARCH\REPOSITORY\Grasshopper\Xtras\DsearchCode"
if new_path not in sys.path: sys.path.append(new_path)

#import dsearch plugin
import dsearch as ds

import os

print sys.path

#reload module (this has use when working on module)
#reload(ds.DS_Log)
#reload(ds.DS_Links)

#setup template
template=ds.DS_Links.Template
ds.DS_Log.DS_Template(template)

#run help from module 
if Help:
    helpLink=ds.DS_Links.HelpLink
    ds.DS_Log.DS_Help(helpLink)

    #turn toggle back to false
    obj=ghenv.Component.Params.Input[0].Sources[0]
    obj.Value=False
    obj.ExpireSolution(True)
# ---------- end dss_log_v5_2 ----------

dss_projectnumber = Panel("0000")
dss_projectname = Panel("name")

# ----
# Organization of Grasshopper scripts at White:
# Script should be created and annotated always with notion that other person will need to use/edit them.
# Build your script in modules and segments, use color coding and annotation according this template.
# This standard should be applied to all scripts, big or small.
# 
# Read  guide on white work:
# "https://work.white.se/grasshopper-developer-guide/"
# For Advanced users:
# For design scripts running more than a month use "dsInitialize" and "dsScriptLog" functions on Dsearch tab to log changes over time.
dss_annotation_panel_2 = Panel("""Tip of a day:
You can change default colour grups by right clicking
Graphical templates are located on "Dsearch" tab""")
# GRAPHIC
# STANDARD
# In
# data and geometry import from rhino or external platforms
image = ImageSampler(dss_annotation_panel_2, Filter="Colour", Interpolate=False, Umax=1, Umin=0, Vmax=1, Vmin=0, Wrap=0)

active_selection = GraphicalElement()

# ---- group: Only tags
query_categories = QueryCategories(Type=2, IsVisibleUI=True, IsSubcategory=False)
match_text = MatchText(Text=query_categories, RegEx="Tags", Case=True)
match_text_2 = MatchText(Text=query_categories, RegEx="Room Tags", Case=True)
cull_pattern = CullPattern(List=query_categories, CullPattern=match_text)
category_filter = CategoryFilter(Categories=cull_pattern, Inverted=False)
filter_elements = FilterElements(Elements=active_selection, Filter=category_filter)
cull_pattern_2 = CullPattern(List=active_selection, CullPattern=filter_elements)

# ----
# Control
# General
# Monitor
# Out
# variable parameters and script execution
# (sliders, boolean togggle, text input,...)
# monitor data and geometry preview (used for panels for example)
# output data to rhino or external platforms
# WIP
# Annotation
# Plugin
# general annotation and notes
# textbased scripting and special plugins
# f.ex: HumanUI, kangaroo,...
# problematic or under repair or construction
dss_annotation_panel_3 = Panel("general development modules")

panel = Panel("""Floors
Site
Rooms
Walls
Lines""")
query_categories_2 = QueryCategories(Discipline=1, Type=2, IsVisibleUI=True, IsSubcategory=False)
query_categories_3 = QueryCategories(Type=2, Name="Grids", IsVisibleUI=True, IsSubcategory=False)  # -> flatten(Categories)
query_categories_4 = QueryCategories(Type=1, Name=panel, IsVisibleUI=True, IsSubcategory=False)  # -> flatten(Categories)
query_categories_5 = QueryCategories(Type=1, Name="Doors", IsVisibleUI=True, IsSubcategory=False)  # -> flatten(Categories)
match_text_3 = MatchText(Text=query_categories_2, RegEx="Tag", Case=True)
query_categories_6 = QueryCategories(Type=1, Name="Walls", IsVisibleUI=True, IsSubcategory=False)  # -> flatten(Categories)
cull_pattern_3 = CullPattern(List=query_categories_2, CullPattern=match_text_3)
category_filter_2 = CategoryFilter(Categories=query_categories_6, Inverted=False)
unit_z = UnitZ(Factor=Slider(6932, range=0..10000))
category_filter_3 = CategoryFilter(Categories=query_categories_5, Inverted=False)
query_categories_7 = QueryCategories(Type=1, Name="Lines", IsVisibleUI=True, IsSubcategory=False)  # -> flatten(Categories)
query_elements = QueryElements(Filter=category_filter_3)  # -> Elements, Count
category_filter_4 = CategoryFilter(Categories=query_categories_3, Inverted=False)
category_filter_5 = CategoryFilter(Categories=query_categories_7, Inverted=False)
visible_in_view_filter = VisibleInViewFilter(Inverted=False)
query_elements_2 = QueryElements(Filter=category_filter_4)  # -> Elements, Count
number_slider = Slider(1000, range=0..1000)
power_of_10 = PowerOf10(Value=Slider(6, range=0..10))

query_categories_8 = QueryCategories(Type=1, Name="Lines", IsVisibleUI=True, IsSubcategory=False)
add_subcategory = AddSubCategory(Parent=query_categories_8, Name="Tags_Kontroll_RiR", FailureProcessingMode=1, TrackingMode=2)
category_style = CategoryStyle(Category=add_subcategory, LineWeight_projection="12", LineColor=ColourSwatch(SwatchColor=RGB(0, 0, 255)))  # -> Category, LineWeight_projection, LineWeight_cut, LineColor, LinePattern_projection, Material

active_view = ActiveView()

# ---- group: Query elements in view
list_item = ListItem(List=cull_pattern_2, Index=0, Wrap=True)
element_type = ElementType(Element=list_item)  # -> Element, Type
# Back-end
active_view_2 = ActiveView()

# ----
element_category = ElementCategory(Element=list_item)  # -> Element, Category
category_filter_6 = CategoryFilter(Categories=element_category.Category, Inverted=False)
annotation_references = AnnotationReferences(Annotation=simplify(element_category.Element))  # -> simplify(References)

# ---- group: Query elements in view (continued)
query_view_elements = QueryViewElements(View=active_view_2, Categories=cull_pattern, Filter=category_filter_6)

# ----
element_category_2 = ElementCategory(Element=annotation_references)  # -> Element, Category
set_difference = SetDifference(SetA=cull_pattern_3, SetB=element_category.Category)

# ---- group: Check for room tags
cull_pattern_4 = CullPattern(List=query_categories, CullPattern=match_text_2)
category_filter_7 = CategoryFilter(Categories=cull_pattern_4, Inverted=False)
filter_elements_2 = FilterElements(Elements=query_view_elements, Filter=category_filter_7)
cull_pattern_5 = CullPattern(List=query_view_elements, CullPattern=filter_elements_2)

# ----
category = Category(set_difference)
category_filter_8 = CategoryFilter(Categories=flatten(category), Inverted=False)
category_filter_9 = CategoryFilter(Categories=flatten([cull_pattern_4, query_categories_4, query_categories_3, element_category_2.Category]), Inverted=True)
view = View(active_view_2)
level = Level(view)
plane = Plane(level)
visible_in_view_filter_2 = VisibleInViewFilter(View=view, Inverted=False)
logical_and_filter = LogicalAndFilter(FilterA=visible_in_view_filter_2, FilterB=category_filter_2)
logical_and_filter_2 = LogicalAndFilter(FilterA=visible_in_view_filter_2, FilterB=category_filter_8)
logical_and_filter_3 = LogicalAndFilter(FilterA=visible_in_view_filter_2, FilterB=category_filter_9)
view_2 = View(active_view_2)
cull_pattern_6 = CullPattern(List=query_view_elements, CullPattern=invert(filter_elements_2))
query_elements_3 = QueryElements(Filter=logical_and_filter_3)  # -> Elements, Count
query_view_elements_2 = QueryViewElements(View=view_2, Categories=category, Filter=logical_and_filter_2)
match_text_4 = MatchText(Text=query_view_elements_2, RegEx="Tag", Case=True)
query_elements_4 = QueryElements(Filter=logical_and_filter)  # -> Elements, Count
bounding_rectangle = BoundingRectangle(Geometry=query_elements_4.Elements, Plane=plane, Axis=0, Slide=0, Union=True)  # -> Bounding, DimensionX, DimensionY
project = Project(Geometry=bounding_rectangle.Bounding, Plane=plane)  # -> Geometry, Transform
extrude = Extrude(Base=project.Geometry, Direction=unit_z)
cap_holes = CapHoles(Brep=extrude)
volume = Volume(Geometry=cap_holes)  # -> Volume, Centroid
scale = Scale(Geometry=cap_holes, Center=volume.Centroid, Factor=Slider(1.2, range=0..10))  # -> Geometry, Transform
graphical_element = GraphicalElement(query_elements_3.Elements)
bounding_box_filter = BoundingBoxFilter(BoundingBox=scale.Geometry, Union=True, Strict=True, Tolerance=0, Inverted=False)  # -> Filter, Target

annotation_references_2 = AnnotationReferences(Annotation=simplify(cull_pattern_5))  # -> simplify(References)
room = Room(annotation_references_2)
spatial_element_boundary = SpatialElementBoundary(SpatialElement=room, BoundaryLocation=0)  # -> simplify(Boundary)

logical_and_filter_4 = LogicalAndFilter(FilterA=visible_in_view_filter_2, FilterB=category_filter_5)
element_view_geometry = ElementViewGeometry(Elements=query_elements.Elements, View=view)  # -> flatten(Elements), Geometry, Categories
cull_pattern_7 = CullPattern(List=query_view_elements_2, CullPattern=match_text_4)
null_item = NullItem(Item=graphical_element)  # -> NullFlags, InvalidFlags, Description
cull_pattern_8 = CullPattern(List=query_elements_3.Elements, CullPattern=invert(null_item.NullFlags))
query_elements_5 = QueryElements(Filter=logical_and_filter_4)  # -> Elements, Count
filter_elements_3 = FilterElements(Elements=query_elements_3.Elements, Filter=bounding_box_filter.Filter)
curve = Curve(element_view_geometry.Geometry)
cull_pattern_9 = CullPattern(List=query_elements_3.Elements, CullPattern=filter_elements_3)
null_item_2 = NullItem(Item=curve)  # -> NullFlags, InvalidFlags, Description

# ---- group: Grids
element_view_geometry_2 = ElementViewGeometry(Elements=query_elements_2.Elements, View=view)  # -> flatten(Elements), flatten(Geometry), Categories

element_view_geometry_3 = ElementViewGeometry(Elements=query_elements_5.Elements, View=view)  # -> flatten(Elements), flatten(Geometry), Categories

# ----
element_view_geometry_4 = ElementViewGeometry(Elements=cull_pattern_9, View=view)  # -> Elements, simplify(Geometry), Categories
cull_pattern_10 = CullPattern(List=curve, CullPattern=invert(null_item_2.NullFlags))
list_length = ListLength(List=cull_pattern_5)
list_length_2 = ListLength(List=cull_pattern_5)
bounding_rectangle_2 = BoundingRectangle(Geometry=element_view_geometry.Geometry, Plane=PlaneXY(0, 0, 0), Axis=0, Slide=0, Union=True)  # -> simplify(Bounding), DimensionX, DimensionY
line = Line(element_view_geometry_4.Geometry)
curve_2 = Curve(element_view_geometry_4.Geometry)
brep = Brep(flatten(element_view_geometry_4.Geometry))
bounding_rectangle_3 = BoundingRectangle(Geometry=simplify(graft(cull_pattern_7)), Plane=PlaneXY(0, 0, 0), Axis=0, Slide=0, Union=True)  # -> simplify(Bounding), DimensionX, DimensionY
line_2 = Line(element_view_geometry_3.Elements)
view_3 = View(active_view_2)
addition = Addition(A=list_length_2, B="0")
null_item_3 = NullItem(Item=curve_2)  # -> NullFlags, InvalidFlags, Description
plane_2 = Plane(view_3)
null_item_4 = NullItem(Item=line_2)  # -> NullFlags, InvalidFlags, Description
null_item_5 = NullItem(Item=brep)  # -> NullFlags, InvalidFlags, Description
boolean = Boolean(addition)
cull_pattern_11 = CullPattern(List=curve_2, CullPattern=invert(null_item_3.NullFlags))
cull_pattern_12 = CullPattern(List=brep, CullPattern=invert(null_item_5.NullFlags))
cull_pattern_13 = CullPattern(List=line_2, CullPattern=invert(null_item_4.NullFlags))
stream_filter = StreamFilter(Gate=boolean, Stream1=spatial_element_boundary)
list_length_3 = ListLength(List=cull_pattern_6)

level_2 = Level(view_3)
element_view_geometry_5 = ElementViewGeometry(Elements=query_elements_4.Elements, View=view)  # -> Elements, simplify(Geometry), Categories
unit_z_2 = UnitZ(Factor="400")
plane_3 = Plane(level_2)
move = Move(Geometry=plane_3, Motion=unit_z_2)  # -> Geometry, Transform
brep_plane = BrepPlane(Brep=element_view_geometry_5.Geometry, Plane=move.Geometry)  # -> Curves, Points

mesh_brep = MeshBrep(
    Brep=cull_pattern_12,
    Settings={GridMaxCount=0, GridMinCount=16, JaggedSeams=False, MaxEdgeLength=0, MinEdgeLength=0.0001, MinTolerance=0, Refine=True, RefineAngle=0, RelativeTolerance=0.65, SimplePlanes=True, Tolerance=0})
bounding_rectangle_4 = BoundingRectangle(Geometry=simplify(graft(cull_pattern_12)), Plane=plane_2, Axis=0, Slide=0, Union=True)  # -> Bounding, DimensionX, DimensionY
area = Area(Geometry=bounding_rectangle_4.Bounding)  # -> Area, Centroid
null_item_6 = NullItem(Item=area.Area)  # -> NullFlags, InvalidFlags, Description
cull_pattern_14 = CullPattern(List=bounding_rectangle_4.Bounding, CullPattern=invert(null_item_6.NullFlags))
cull_pattern_15 = CullPattern(List=area.Area, CullPattern=invert(null_item_6.NullFlags))
sort_list = SortList(Keys=cull_pattern_15, ValuesValuesA=cull_pattern_14)  # -> Keys, ValuesValuesA
list_item_2 = ListItem(List=sort_list.ValuesValuesA, Index=0, Wrap=True)

addition_2 = Addition(A=list_length_3, B="0")
bounding_rectangle_5 = BoundingRectangle(Geometry=simplify(cull_pattern_11), Plane=plane_2, Axis=0, Slide=0, Union=True)  # -> Bounding, DimensionX, DimensionY
boolean_2 = Boolean(addition_2)
curve_3 = Curve([bounding_rectangle_5.Bounding, bounding_rectangle_2.Bounding, bounding_rectangle_3.Bounding])
null_item_7 = NullItem(Item=curve_3)  # -> NullFlags, InvalidFlags, Description
cull_pattern_16 = CullPattern(List=curve_3, CullPattern=invert(null_item_7.InvalidFlags))  # -> simplify(flatten(List))

# ---- group: Offset and bool union to simplify calc.
project_2 = Project(Geometry=list_item_2, Plane=plane_2)  # -> flatten(Geometry), Transform
offset_curve = OffsetCurve(Curve=cull_pattern_16, Plane=plane_2, Distance=Slider(50, range=0..1000), BothSides=0, Kinks=0, CapType=1)  # -> flatten(Offset)
region_union = RegionUnion(Curves=offset_curve, Plane=plane_2)  # -> simplify(Result)

# ----
offset_curve_2 = OffsetCurve(Curve=brep_plane.Curves, Distance="150", Corners=1)  # -> simplify(Curve)

line_3 = Line([element_view_geometry_2.Elements, cull_pattern_13])
project_3 = Project(Geometry=line_3, Plane=plane_2)  # -> Geometry, Transform

# ---- group: Wall Tags
annotation_references_3 = AnnotationReferences(Annotation=simplify(cull_pattern_6))  # -> simplify(References)
element_location = ElementLocation(Element=annotation_references_3)  # -> Element, Location, Hand, Facing, WorkPlane
bounding_rectangle_6 = BoundingRectangle(Geometry=simplify(graft(annotation_references_3)), Plane=element_location.WorkPlane, Axis=0, Slide=0, Union=True)  # -> simplify(Bounding), simplify(DimensionX), simplify(DimensionY)
offset_curve_3 = OffsetCurve(Curve=bounding_rectangle_6.Bounding, Distance="800", Plane=element_location.Location, Corners=1)  # -> simplify(Curve)

# ----
element_curve = ElementCurve(Element=annotation_references_3)  # -> Element, Curve

# ---- group: Adjoustin domains
deconstruct_box = DeconstructBox(Box=offset_curve_3)  # -> Plane, X, Y, Z
deconstruct_box_2 = DeconstructBox(Box=bounding_rectangle_6.Bounding)  # -> Plane, X, Y, Z
deconstruct_domain = DeconstructDomain(Domain=deconstruct_box.X)  # -> Start, End
deconstruct_domain_2 = DeconstructDomain(Domain=deconstruct_box.Y)  # -> Start, End
deconstruct_domain_3 = DeconstructDomain(Domain=deconstruct_box.X)  # -> Start, End
deconstruct_domain_4 = DeconstructDomain(Domain=deconstruct_box.Y)  # -> Start, End
subtraction = Subtraction(A=deconstruct_domain.End, B=deconstruct_domain.Start)
subtraction_2 = Subtraction(A=deconstruct_domain_2.End, B=deconstruct_domain_2.Start)
subtraction_3 = Subtraction(A=deconstruct_domain_3.End, B=deconstruct_domain_3.Start)
subtraction_4 = Subtraction(A=deconstruct_domain_4.End, B=deconstruct_domain_4.Start)
smaller_than = SmallerThan(FirstNumber=subtraction, SecondNumber=subtraction_2)  # -> SmallerThan, OrEqualTo
smaller_than_2 = SmallerThan(FirstNumber=subtraction_3, SecondNumber=subtraction_4)  # -> SmallerThan, OrEqualTo
cull_pattern_17 = CullPattern(List=subtraction_2, CullPattern=invert(smaller_than.SmallerThan))
cull_pattern_18 = CullPattern(List=subtraction, CullPattern=smaller_than.SmallerThan)
cull_pattern_19 = CullPattern(List=subtraction_3, CullPattern=invert(smaller_than_2.SmallerThan))
cull_pattern_20 = CullPattern(List=subtraction_4, CullPattern=smaller_than_2.SmallerThan)
number = Number([cull_pattern_18, cull_pattern_17])
number_2 = Number([cull_pattern_19, cull_pattern_20])
multiplication = Multiplication(A="800", B="2")
subtraction_5 = Subtraction(A=number_2, B=multiplication)
division = Division(A=number, B="2")
negative = Negative(Value=division)
division_2 = Division(A=subtraction_5, B="2")
negative_2 = Negative(Value=division_2)
construct_domain = ConstructDomain(DomainStart=negative, DomainEnd=division)
construct_domain_2 = ConstructDomain(DomainStart=negative_2, DomainEnd=division_2)
rectangle = Rectangle(Plane=element_location.Location, XSize=construct_domain_2, YSize=construct_domain, Radius=0)  # -> Rectangle, Length

# ----
stream_filter_2 = StreamFilter(Gate=boolean_2, Stream1=rectangle.Rectangle)

# ---- group: Wall Tags (continued)
curve_4 = Curve([stream_filter_2, stream_filter])

# ---- group: Check if elements are inside crv?
length = Length(Curve=curve_4)
sort_list_2 = SortList(Keys=length, ValuesValuesA=curve_4)  # -> Keys, reverse(ValuesValuesA)
list_item_3 = ListItem(List=sort_list_2.ValuesValuesA, Index=0, Wrap=True)
curve_5 = Curve(list_item_3)

# ---- group: Possible area to place tag
project_4 = Project(Geometry=curve_5, Plane=plane_2)  # -> Geometry, Transform
boundary_surfaces = BoundarySurfaces(Edges=project_4.Geometry)

# ---- group: Walls
region_union_2 = RegionUnion(Curves=flatten(offset_curve_2), Plane=plane_2)  # -> simplify(Result)
boundary_surfaces_2 = BoundarySurfaces(Edges=region_union_2)  # -> flatten(Surfaces)
collision_one_many = CollisionOneMany(Collider=flatten(boundary_surfaces_2), Obstacles=boundary_surfaces)  # -> Collision, Index
cull_pattern_21 = CullPattern(List=region_union_2, CullPattern=collision_one_many.Collision)
curve_6 = Curve(simplify(cull_pattern_21))
clean_tree = CleanTree(RemoveNulls=True, RemoveInvalid=True, RemoveEmpty=False, Tree=curve_6)

# ---- group: Other things
project_5 = Project(Geometry=region_union, Plane=plane_2)  # -> Geometry, Transform
boundary_surfaces_3 = BoundarySurfaces(Edges=project_5.Geometry)  # -> flatten(Surfaces)
collision_one_many_2 = CollisionOneMany(Collider=boundary_surfaces_3, Obstacles=boundary_surfaces)  # -> Collision, Index
cull_pattern_22 = CullPattern(List=boundary_surfaces_3, CullPattern=collision_one_many_2.Collision)
curve_7 = Curve(cull_pattern_22)
clean_tree_2 = CleanTree(RemoveNulls=True, RemoveInvalid=True, RemoveEmpty=True, Tree=curve_7)
relay = Relay([clean_tree, clean_tree_2])

# ----
curve_8 = Curve(boundary_surfaces)
plane_4 = Plane(plane_2)

region_difference = RegionDifference(CurvesA=curve_8, CurvesB=relay, Plane=plane_4)  # -> simplify(Result)

# ---- group: Intersection and creation of surface
clean_tree_3 = CleanTree(RemoveNulls=True, RemoveInvalid=True, RemoveEmpty=True, Tree=region_difference)
boundary_surfaces_4 = BoundarySurfaces(Edges=clean_tree_3)  # -> simplify(Surfaces)
project_6 = Project(Geometry=boundary_surfaces_4, Plane=plane_2)  # -> Geometry, Transform

# ---- group: Largest fragment / Slice with grid
surface_split = SurfaceSplit(Surface=project_6.Geometry, Curves=project_3.Geometry)  # -> simplify(Fragments)
path_mapper = PathMapper(surface_split, source="{A;B}", target="{A}")

# ---- group: Largest fragment
surface = Surface(path_mapper)
surface_2 = Surface(surface)
area_2 = Area(Geometry=surface_2)  # -> Area, Centroid
sort_list_3 = SortList(Keys=area_2.Area, ValuesValuesA=surface_2)  # -> Keys, reverse(ValuesValuesA)
list_item_4 = ListItem(List=sort_list_3.ValuesValuesA, Index=0, Wrap=True)

# ----
area_3 = Area(Geometry=list_item_4)  # -> Area, Centroid
smaller_than_3 = SmallerThan(FirstNumber=area_3.Area, SecondNumber=power_of_10)  # -> SmallerThan, OrEqualTo
cull_pattern_23 = CullPattern(List=list_item_4, CullPattern=invert(smaller_than_3.SmallerThan))

# ---- group: Point of mesh furthest from edge
panel_2 = Panel("250")

# ---- group: Point of mesh furthest from edge / Find point of mesh furthest from edge
cluster = Cluster(brep=flatten(cull_pattern_23), max_edge=panel_2)

# ---- group: Point of mesh furthest from edge (continued)
point = Point(flatten(cluster))
surface_closest_point = SurfaceClosestPoint(Point=point, Surface=cull_pattern_23)  # -> Point, UVPoint, Distance
boolean_3 = Boolean(surface_closest_point.Distance)

# ----
cull_pattern_24 = CullPattern(List=surface_closest_point.Point, CullPattern=invert(boolean_3))
graphical_element_2 = GraphicalElement(query_view_elements)

clean_tree_4 = CleanTree(RemoveNulls=True, RemoveInvalid=True, RemoveEmpty=True, Tree=cull_pattern_24)

list_item_5 = ListItem(List=clean_tree_4, Index=0, Wrap=True)
tree_statistics = TreeStatistics(Tree=list_item_5)  # -> Paths, Length, Count
tree_branch = TreeBranch(Tree=simplify(graft(graphical_element_2)), Path=tree_statistics.Paths, MaintainPaths=True)

element_location_2 = ElementLocation(Element=simplify(tree_branch), Location=list_item_5)  # -> Element, Location, Hand, Facing, WorkPlane
bounding_rectangle_7 = BoundingRectangle(Geometry=element_location_2.Element, Plane=PlaneXY(0, 0, 0), Axis=0, Slide=0, Union=True)  # -> Bounding, DimensionX, DimensionY
area_4 = Area(Geometry=bounding_rectangle_7.Bounding)  # -> Area, Centroid
point_2 = Point(element_location_2.Location)
vector_2pt = Vector2Pt(PointA=point_2, PointB=area_4.Centroid, Unitize=False)  # -> simplify(Vector), Length
negative_3 = Negative(Value=vector_2pt.Vector)
move_2 = Move(Geometry=element_location_2.Location, Motion=negative_3)  # -> Geometry, Transform
element_location_3 = ElementLocation(Element=simplify(element_location_2.Element), Location=move_2.Geometry)  # -> Element, Location, Hand, Facing, WorkPlane
bounding_rectangle_8 = BoundingRectangle(Geometry=element_location_3.Element, Plane=PlaneXY(0, 0, 0), Axis=0, Slide=0, Union=True)  # -> Bounding, DimensionX, DimensionY
select_element = SelectElement(Element=element_location_3.Element, Selected=Toggle(True))  # -> Element, Selected
explode = Explode(Curve=bounding_rectangle_8.Bounding, Recursive=True)  # -> Segments, Vertices
add_detail_line = AddDetailLine(View=active_view, Curve=explode.Segments, TrackingMode=1)
curve_line_style = CurveLineStyle(Element=add_detail_line, LineStyle=category_style.Category)  # -> Element, LineStyle

# ==== cluster Cluster
max_edge = ClusterInput()
settings_custom = SettingsCustom(
    StitchSeams=True,
    SimplePlanes=Toggle(False),
    Refine=True,
    MinCount=16,
    MaxCount=400,
    AspectRatio=20,
    MaxDistance=0,
    MaxAngle=20,
    MinEdge=0,
    MaxEdge=max_edge)
brep = ClusterInput()
mesh_brep = MeshBrep(Brep=brep, Settings=settings_custom)
deconstruct_mesh = DeconstructMesh(Mesh=mesh_brep)  # -> simplify(Vertices), Faces, Colours, Normals
mesh_edges = MeshEdges(Mesh=mesh_brep)  # -> NakedEdges, InteriorEdges, NonManifoldEdges
join_curves = JoinCurves(Curves=mesh_edges.NakedEdges, Preserve=False)  # -> simplify(Curves)
curve_closest_point = CurveClosestPoint(Point=simplify(graft(deconstruct_mesh.Vertices)), Curve=simplify(flatten(join_curves)))  # -> Point, Parameter, Distance
sort_list = SortList(Keys=curve_closest_point.Distance, ValuesValuesA=curve_closest_point.Point)  # -> Keys, ValuesValuesA
list_item = ListItem(List=sort_list.ValuesValuesA, Index=0, Wrap=True)
data = Data(simplify(graft(deconstruct_mesh.Vertices)))
line = Line(StartPoint=data, EndPoint=list_item)
path_mapper = PathMapper(data, source="{A;B}", target="{A}")
path_mapper_2 = PathMapper(line, source="{A;B}", target="{A}")
data_2 = Data(path_mapper)
data_3 = Data(path_mapper_2)
length = Length(Curve=data_3)
sort_list_2 = SortList(Keys=length, ValuesValuesA=data_2)  # -> Keys, reverse(ValuesValuesA)
list_item_2 = ListItem(List=sort_list_2.ValuesValuesA, Index=0, Wrap=True)
i = ClusterOutput(list_item_2)
